# Grasshopper definition matchTest.gh (Grasshopper 1.0.7)
# plug-ins: MatchCurve

value_list = ValueList({"Pos": 1, "Tan": 2, "Cur": 3}, selected="Cur")
reference_curve = ReferenceCurve([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])
curve = Curve([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])
custom_preview = CustomPreview(Geometry=reference_curve, Material=ColourSwatch(SwatchColor=RGB(0, 0, 255)))
match_curve = MatchCurve(
    ReferenceCurve=reference_curve,
    Curve=curve,
    Continuity=value_list,
    Parameter=Slider(1, range=0..1),
    IsNormalized=True,
    ReverseReference=False,
    ReverseCurve=invert(False),
    FactorTangency=Slider(1, range=0..3),
    FactorCurvature=Slider(1, range=0..3),
    TrimReference=True,
    Join=invert(False))  # -> Curve, Reference, Joined
custom_preview_2 = CustomPreview(Geometry=curve, Material=ColourSwatch(SwatchColor=RGB(0, 0, 255)))
curve_2 = Curve(match_curve.Curve)
curve_3 = Curve(match_curve.Reference)
curve_4 = Curve(match_curve.Joined)
custom_preview_3 = CustomPreview(Geometry=match_curve.Curve, Material=ColourSwatch(SwatchColor=RGB(255, 255, 0)))
control_points = ControlPoints(Curve=curve_2)  # -> Points, Weights, Knots
curvature_graph = CurvatureGraph(Curve=[curve_2, curve_3], Density=Slider(39, range=0..1000), Scale=Slider(108, range=100..200))
polyline = PolyLine(Vertices=control_points.Points, Closed=False)
circle_cnr = CircleCNR(Center=control_points.Points, Normal=Vector(0, 0, 1), Radius=0.2)
custom_preview_4 = CustomPreview(Geometry=[circle_cnr, polyline], Material=ColourSwatch(SwatchColor=RGB(235, 235, 235)))
